# Dynamo graph Project_EXPO_1.11_Roof_Surface.dyn "1-094-SA-PAL-EXPO_ATENOR-AQ-R00A_Cobertura71" (Dynamo 2.6.1.8786)
# packages: spring nodes 204.1.0

# group: y_value
code_block = CodeBlock { 6.256; }

slab_level_height = DoubleSlider(10.05, range=0..20 step 0.1)

# group: Input Steep Slope
top_point = CodeBlock(y_value=code_block, z=slab_level_height) { Point.ByCoordinates(-59.935,y_value,z); }
bottom_point = CodeBlock { Point.ByCoordinates(-60.393,-5.397,2.3); }

byCenterPointRadius = Sphere.ByCenterPointRadius(centerPoint=top_point)
byStartPointEndPoint = Line.ByStartPointEndPoint(startPoint=bottom_point, endPoint=top_point)
parameters = CodeBlock { 0..1..0.1; }
pointAtParameter = Curve.PointAtParameter(curve=byStartPointEndPoint, param=parameters)

# group: Control Points Steep Slope
number_slider = DoubleSlider(-0.5, range=-5..5 step 0.1)  # graph input
number_slider_2 = DoubleSlider(-0.8, range=-5..5 step 0.1)  # graph input
number_slider_3 = DoubleSlider(-0.5, range=-5..5 step 0.1)  # graph input
number_slider_4 = DoubleSlider(-0.2, range=-5..5 step 0.1)  # graph input
number_slider_5 = DoubleSlider(0.2, range=-5..5 step 0.1)  # graph input
number_slider_6 = DoubleSlider(0.5, range=-5..5 step 0.1)  # graph input
number_slider_7 = DoubleSlider(0.55, range=-5..5 step 0.1)  # graph input
number_slider_8 = DoubleSlider(0.7, range=-5..5 step 0.1)  # graph input
number_slider_9 = DoubleSlider(0.775, range=-5..5 step 0.1)  # graph input

code_block_2 = CodeBlock(a=pointAtParameter, h=number_slider)
# ---------- code_block_2.designscript (3 lines) ----------
//Control 1
c1=a[1];
control1=Point.ByCoordinates(c1.X,c1.Y,c1.Z+h);
# ----------------------------------------
code_block_3 = CodeBlock(a=pointAtParameter, h=number_slider_2)
# ---------- code_block_3.designscript (3 lines) ----------
//Control 2
c1=a[2];
control1=Point.ByCoordinates(c1.X,c1.Y,c1.Z+h);
# ----------------------------------------
code_block_4 = CodeBlock(a=pointAtParameter, h=number_slider_3)
# ---------- code_block_4.designscript (3 lines) ----------
//Control 3
c1=a[3];
control1=Point.ByCoordinates(c1.X,c1.Y,c1.Z+h);
# ----------------------------------------
code_block_5 = CodeBlock(a=pointAtParameter, h=number_slider_4)
# ---------- code_block_5.designscript (3 lines) ----------
//Control 4
c1=a[4];
control1=Point.ByCoordinates(c1.X,c1.Y,c1.Z+h);
# ----------------------------------------
code_block_6 = CodeBlock(a=pointAtParameter, h=number_slider_5)
# ---------- code_block_6.designscript (3 lines) ----------
//Control 5
c1=a[5];
control1=Point.ByCoordinates(c1.X,c1.Y,c1.Z+h);
# ----------------------------------------
code_block_7 = CodeBlock(a=pointAtParameter, h=number_slider_6)
# ---------- code_block_7.designscript (3 lines) ----------
//Control 6
c1=a[6];
control1=Point.ByCoordinates(c1.X,c1.Y,c1.Z+h);
# ----------------------------------------
code_block_8 = CodeBlock(a=pointAtParameter, h=number_slider_7)
# ---------- code_block_8.designscript (3 lines) ----------
//Control 7
c1=a[7];
control1=Point.ByCoordinates(c1.X,c1.Y,c1.Z+h);
# ----------------------------------------
code_block_9 = CodeBlock(a=pointAtParameter, h=number_slider_8)
# ---------- code_block_9.designscript (3 lines) ----------
//Control 8
c1=a[8];
control1=Point.ByCoordinates(c1.X,c1.Y,c1.Z+h);
# ----------------------------------------
code_block_10 = CodeBlock(a=pointAtParameter, h=number_slider_9)
# ---------- code_block_10.designscript (3 lines) ----------
//Control 9
c1=a[9];
control1=Point.ByCoordinates(c1.X,c1.Y,c1.Z+h);
# ----------------------------------------
code_block_11 = CodeBlock(a=pointAtParameter, b=code_block_2.control1, c=code_block_3.control1, d=code_block_4.control1, e=code_block_5.control1, f=code_block_6.control1, g=code_block_7.control1, h=code_block_8.control1, i=code_block_9.control1, j=code_block_10.control1) { [a[0],b,c,d,e,f,g,h,i,j,a[10]]; }
byCenterPointRadius_2 = Sphere.ByCenterPointRadius(centerPoint=code_block_11)

# group: x_value
code_block_12 = CodeBlock { 15.395; }

# group: Input Soft Slope
bottom_point_2 = CodeBlock { Point.ByCoordinates(-42.599,-32.454,1.28); }
top_point_2 = CodeBlock(v_value=code_block_12, z=slab_level_height) { Point.ByCoordinates(v_value,-36.229,z); }

byCenterPointRadius_3 = Sphere.ByCenterPointRadius(centerPoint=bottom_point_2)
byCenterPointRadius_4 = Sphere.ByCenterPointRadius(centerPoint=top_point_2)
byStartPointEndPoint_2 = Line.ByStartPointEndPoint(startPoint=bottom_point_2, endPoint=top_point_2)
pointAtParameter_2 = Curve.PointAtParameter(curve=byStartPointEndPoint_2, param=parameters)

# group: Control Points Soft Slope
number_slider_10 = DoubleSlider(-0.5, range=-5..5 step 0.1)  # graph input
number_slider_11 = DoubleSlider(-0.7, range=-5..5 step 0.1)  # graph input
number_slider_12 = DoubleSlider(-0.8, range=-5..5 step 0.1)  # graph input
number_slider_13 = DoubleSlider(-0.9, range=-5..5 step 0.1)  # graph input
number_slider_14 = DoubleSlider(-0.8, range=-5..5 step 0.1)  # graph input
number_slider_15 = DoubleSlider(-0.6, range=-5..5 step 0.1)  # graph input
number_slider_16 = DoubleSlider(-0.3, range=-5..5 step 0.1)  # graph input
number_slider_17 = DoubleSlider(0.5, range=-5..5 step 0.1)  # graph input
number_slider_18 = DoubleSlider(0.805, range=-5..5 step 0.1)  # graph input

code_block_13 = CodeBlock(a=pointAtParameter_2, h=number_slider_10)  # same code as code_block_2
code_block_14 = CodeBlock(a=pointAtParameter_2, h=number_slider_11)  # same code as code_block_3
code_block_15 = CodeBlock(a=pointAtParameter_2, h=number_slider_12)  # same code as code_block_4
code_block_16 = CodeBlock(a=pointAtParameter_2, h=number_slider_13)  # same code as code_block_5
code_block_17 = CodeBlock(a=pointAtParameter_2, h=number_slider_14)  # same code as code_block_6
code_block_18 = CodeBlock(a=pointAtParameter_2, h=number_slider_15)  # same code as code_block_7
code_block_19 = CodeBlock(a=pointAtParameter_2, h=number_slider_16)  # same code as code_block_8
code_block_20 = CodeBlock(a=pointAtParameter_2, h=number_slider_17)  # same code as code_block_9
code_block_21 = CodeBlock(a=pointAtParameter_2, h=number_slider_18)  # same code as code_block_10
code_block_22 = CodeBlock(a=pointAtParameter_2, b=code_block_13.control1, c=code_block_14.control1, d=code_block_15.control1, e=code_block_16.control1, f=code_block_17.control1, g=code_block_18.control1, h=code_block_19.control1, i=code_block_20.control1, j=code_block_21.control1) { [a[0],b,c,d,e,f,g,h,i,j,a[10]]; }
byCenterPointRadius_5 = Sphere.ByCenterPointRadius(centerPoint=code_block_22)
byCenterPointRadius_6 = Sphere.ByCenterPointRadius(centerPoint=bottom_point)

# group: Input Limit Points Sidewalk
code_block_23 = CodeBlock()
# ---------- code_block_23.designscript (8 lines) ----------
Point.ByCoordinates(-60.927,-12.505,2);
Point.ByCoordinates(-55.270,-13.498,1.97);
Point.ByCoordinates(-52.205,-15.308,1.931);
Point.ByCoordinates(-48.325,-20.432,1.803);
Point.ByCoordinates(-46.354,-24.217,1.639);
Point.ByCoordinates(-45.780,-25.476,1.584);
Point.ByCoordinates(-45.241,-26.751,1.529);
Point.ByCoordinates(-42.599,-32.454,1.28);
# ----------------------------------------

create = List.Create(item0=code_block_23.out0, item1=code_block_23.out1, item2=code_block_23.out2, item3=code_block_23.out3, item4=code_block_23.out4, item5=code_block_23.out5, item6=code_block_23.out6, item7=code_block_23.out7)
byCenterPointRadius_7 = Sphere.ByCenterPointRadius(centerPoint=create)
reverse = List.Reverse(list=code_block_11)
addItemToEnd = List.AddItemToEnd(item=create, list=reverse)
flatten = List.Flatten(list=addItemToEnd)
byCenterPointRadius_8 = Sphere.ByCenterPointRadius(centerPoint=flatten)
code_block_24 = CodeBlock(a=pointAtParameter)
# ---------- code_block_24.designscript (3 lines) ----------
//Control 10
c1=a[10];
control1=Point.ByCoordinates(c1.X,c1.Y,c1.Z);
# ----------------------------------------
code_block_25 = CodeBlock(a=pointAtParameter_2)  # same code as code_block_24

# group: Input Slab Points
code_block_26 = CodeBlock(x_value=code_block_12, y_value=code_block, z=slab_level_height) { Point.ByCoordinates(x_value,y_value,z); }

# group: Parallel points to Passeio Baltico
byStartPointEndPoint_3 = Line.ByStartPointEndPoint(startPoint=code_block_26, endPoint=top_point)
pointAtParameter_3 = Curve.PointAtParameter(curve=byStartPointEndPoint_3, param=parameters)

# group: Parallel points to Av. Mediterraneo
byStartPointEndPoint_4 = Line.ByStartPointEndPoint(startPoint=top_point_2, endPoint=code_block_26)
pointAtParameter_4 = Curve.PointAtParameter(curve=byStartPointEndPoint_4, param=parameters)

addItemToEnd_2 = List.AddItemToEnd(item=code_block_22, list=flatten)
flatten_2 = List.Flatten(list=addItemToEnd_2)
addItemToEnd_3 = List.AddItemToEnd(item=pointAtParameter_4, list=flatten_2)
flatten_3 = List.Flatten(list=addItemToEnd_3)
addItemToEnd_4 = List.AddItemToEnd(item=pointAtParameter_3, list=flatten_3)
flatten_4 = List.Flatten(list=addItemToEnd_4)

# group: All Points
pruneDuplicates = Point.PruneDuplicates(points=flatten_4)

byPerimeterPoints = Surface.ByPerimeterPoints(points=pruneDuplicates)
code_block_27 = CodeBlock { 0..1..#20; }
pointAtParameter_5 = Surface.PointAtParameter(surface=byPerimeterPoints, u=code_block_27, v=code_block_27, lacing=CrossProduct)
byPoints = NurbsSurface.ByPoints(points=pointAtParameter_5)
file_path = Filename("..\..\..\..\ProgramData\Autodesk\RVT 2019\Family Templates\English\Conceptual Mass\Metric Mass.rft")

# group: ROOF
string = StringInput("Roof_Surface")  # graph input
categories = Categories("OST_Mass")  # graph input
code_block_28 = CodeBlock { "Default"; }
byName = Material.ByName(name=code_block_28)
ꟿ_familyinstance_bygeometry = Custom[ꟿ FamilyInstance.ByGeometry](geometry=byPoints, familyTemplatePath=file_path, familyName=string, category=categories, materialName=byName)  # frozen; package spring nodes

bottom_point_3 = CodeBlock { Point.ByCoordinates(-35.977,-32.941,2); }
byCenterPointRadius_9 = Sphere.ByCenterPointRadius(centerPoint=pointAtParameter_4)
byCenterPointRadius_10 = Sphere.ByCenterPointRadius(centerPoint=pointAtParameter_3)
byCenterPointRadius_11 = Sphere.ByCenterPointRadius(centerPoint=flatten_4)
byCenterPointRadius_12 = Sphere.ByCenterPointRadius(centerPoint=code_block_26)
