# Dynamo graph Project_The_Gherkin_Tower.dyn "The Gherkin Tower, London" (Dynamo 2.6.1.8786)
# packages: Diamond Panels (4pt) 1.0.0, Diamond Panels (3pt) 1.0.0

# group: Profile
number = DoubleInput(0)
elevation = DoubleSlider(176, range=0..176 step 0.1)
byCoordinates = Point.ByCoordinates(x=number, y=number, z=elevation)
radius = DoubleSlider(3, range=0..100 step 0.1)
byCenterPointRadius = Circle.ByCenterPointRadius(centerPoint=byCoordinates, radius=radius)

# group: Profile
number_2 = DoubleInput(0)
elevation_2 = DoubleSlider(173, range=0..173 step 0.1)
byCoordinates_2 = Point.ByCoordinates(x=number_2, y=number_2, z=elevation_2)
radius_2 = DoubleSlider(7, range=0..100 step 0.1)
byCenterPointRadius_2 = Circle.ByCenterPointRadius(centerPoint=byCoordinates_2, radius=radius_2)

# group: Profile
number_3 = DoubleInput(0)
elevation_3 = DoubleSlider(168, range=0..173 step 0.1)
byCoordinates_3 = Point.ByCoordinates(x=number_3, y=number_3, z=elevation_3)
radius_3 = DoubleSlider(11, range=0..100 step 0.1)
byCenterPointRadius_3 = Circle.ByCenterPointRadius(centerPoint=byCoordinates_3, radius=radius_3)

# group: Profile
number_4 = DoubleInput(0)
elevation_4 = DoubleSlider(84, range=0..173 step 0.1)
byCoordinates_4 = Point.ByCoordinates(x=number_4, y=number_4, z=elevation_4)
radius_4 = DoubleSlider(28.5, range=0..100 step 0.1)
byCenterPointRadius_4 = Circle.ByCenterPointRadius(centerPoint=byCoordinates_4, radius=radius_4)

# group: Profile
number_5 = DoubleInput(0)
elevation_5 = DoubleSlider(0, range=0..100 step 0.1)
byCoordinates_5 = Point.ByCoordinates(x=number_5, y=number_5, z=elevation_5)
radius_5 = DoubleSlider(25, range=0..100 step 0.1)
byCenterPointRadius_5 = Circle.ByCenterPointRadius(centerPoint=byCoordinates_5, radius=radius_5)

list_create = List.Create(item0=byCenterPointRadius, item1=byCenterPointRadius_2, item2=byCenterPointRadius_3, item3=byCenterPointRadius_4, item4=byCenterPointRadius_5)
byLoft = Surface.ByLoft(crossSections=list_create)
integer_slider = IntegerSlider(22, range=0..100 step 1)
integer_slider_2 = IntegerSlider(18, range=0..100 step 1)
diamond_panels_4pt = Custom[Diamond Panels (4pt)](byLoft, u=integer_slider, v=integer_slider_2)  # package Diamond Panels (4pt); Based on Nathan Miller's LuncBox
family_types = FamilyTypes("Panel:Not Tainted")
byPoints = AdaptiveComponent.ByPoints(points=diamond_panels_4pt, familyType=family_types)
diamond_panels_3pt = Custom[Diamond Panels (3pt)](byLoft, u=integer_slider, v=integer_slider_2)  # package Diamond Panels (3pt); Based on Nathan Miller's LuncBox
