# Dynamo graph Project_The_Twisted_Building.dyn (Dynamo 2.6.1.8786)
# packages: Clockwork for Dynamo 2.x 2.3.0

# group: Inputs
spin_twist_angle = IntegerSlider(90, range=-1800..1800 step 90)  # graph input
building_s_height = DoubleSlider(3, range=0..15 step 0.1)  # graph input
building_s_width = DoubleSlider(8, range=0..15 step 0.1)  # graph input
number_of_points = DoubleSlider(50, range=0..1000 step 1)  # graph input
building_s_length = DoubleSlider(25, range=0..30 step 0.1)  # graph input
factor = DoubleSlider(0.8, range=0..1 step 0.1)  # graph input
height_difference = DoubleSlider(1, range=0..100 step 0.1)

# group: Section
XZ = Plane.XZ()
code_block = CodeBlock { 180; }
isMultipleOf = Custom[IsMultipleOf](A=spin_twist_angle, B=code_block)  # package Clockwork for Dynamo 2.x; Checks if A is a multiple of B.
different_widths = CodeBlock(x=building_s_height, y=building_s_width, z=number_of_points) { x..y..#z; }
if_ = If(test=isMultipleOf, true=building_s_height, false=different_widths)
different_lengths = List.Reverse(list=different_widths)
if_2 = If(test=isMultipleOf, true=building_s_width, false=different_lengths)
byWidthLength = Rectangle.ByWidthLength(plane=XZ, width=if_, length=if_2)

number_of_points_2 = CodeBlock(l=building_s_length, n=number_of_points) { 0..l..#n; }
translate = Geometry.Translate(geometry=byWidthLength, yTranslation=number_of_points_2)
code_block_2 = CodeBlock { Point.ByCoordinates(0,0,0); }
YAxis = Vector.YAxis()
code_block_3 = CodeBlock(n=number_of_points, f=factor) { n*(1-f); }
code_block_4 = CodeBlock(n=code_block_3) { n/2; }
code_block_5 = CodeBlock(n=number_of_points, f=factor) { n*f; }

# group: Building's Twist
code_block_6 = CodeBlock { 0; }
ofRepeatedItem = List.OfRepeatedItem(item=code_block_6, amount=code_block_4)
code_block_7 = CodeBlock(m=code_block_4, n=code_block_5) { [m,n,m]; }
chop = List.Chop(list=number_of_points_2, lengths=code_block_7)
code_block_8 = CodeBlock { 1; }
getItemAtIndex = List.GetItemAtIndex(list=chop, index=code_block_8)
lastItem = List.LastItem(list=getItemAtIndex)
firstItem = List.FirstItem(list=getItemAtIndex)
code_block_9 = CodeBlock(ang=spin_twist_angle, sup=lastItem, inf=firstItem, x=getItemAtIndex) { g = ang/2*(Math.Sin(180/(sup-inf)*(x-(inf + sup)/2))+1); }
ofRepeatedItem_2 = List.OfRepeatedItem(item=spin_twist_angle, amount=code_block_4)
list_create = List.Create(item0=ofRepeatedItem, item1=code_block_9, item2=ofRepeatedItem_2)
flatten = List.Flatten(list=list_create)

rotate = Geometry.Rotate(geometry=translate, origin=code_block_2, axis=YAxis, degrees=flatten)

# group: Building Z Translation Difference
code_block_10 = CodeBlock(x=height_difference) { x/2; }
code_block_11 = CodeBlock(n=number_of_points, A=code_block_10) { i = 0..(n-1); t = i/(n-1); y = A-A*Math.Cos(180*t); }

translate_2 = Geometry.Translate(geometry=rotate, zTranslation=code_block_11.y)
byLoft = Surface.ByLoft(crossSections=translate_2)
